# Grasshopper definition HeatLossGain.gh (Grasshopper 0.9.76)
# plug-ins: Python Interpreter

# This example file is made 2017.09.20 21.42
panel = Panel("Calculating Heat Loss/Gain")
panel_2 = Panel("(W),(W/m2K),(m2),(K)")
panel_3 = Panel("Q = (U) (A) (∆T)")
panel_4 = Panel("Ventilation")
panel_5 = Panel("Infiltration")
panel_6 = Panel("Radiation")
panel_7 = Panel("Transmission")
python = PythonScript(U=Slider(0.236, range=0.1..1.1), A=Slider(30, range=30..50), dt=Slider(32, range=0..35))  # -> out, Q
# ---------- python: Python ----------
Q = round(U*A*dt,3)
# ---------- end python ----------
panel_8 = Panel(python.Q)
